# Grasshopper definition dev.gh (Grasshopper 1.0.7)
# plug-ins: MetaHopper, Moonlight, Tortoise

# ---- group: Zero length curve
crv = Curve(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)

# ---- group: Interpolated Curve
crv_2 = Curve(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)

# ---- group: Linear Curve
crv_3 = Curve(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)

# ----
panel = Panel("""1
2
3
4""")
crv_4 = Curve([<curve referenced from the Rhino model> x4])
crv_5 = Curve([<curve referenced from the Rhino model> x4])
panel_2 = Panel("""A
B
C
D""")
number_slider = Slider(0, range=0..359)
crv_6 = Curve(<curve referenced from the Rhino model>)
end = EndPoints(Curve=crv)  # -> Start, End
entwine = Entwine(Branch00=crv_4, Branch01=crv_5, FlattenInputs=True)
entwine_2 = Entwine(Branch00=panel, Branch01=panel_2, FlattenInputs=True)
object = ModelObject()  # -> Object, Geometry, Name, Layer, Visibility, Display, Drafting, Render
vec2pt = Vector2Pt(PointA=end.Start, PointB=end.End, Unitize=False)  # -> Vector, Length
massing = ConstructMassing()
grid = ConstructGrid(GridCurves=entwine, GridNames=entwine_2, Flip=False)
panel_3 = Panel("Lotti")
panel_4 = Panel("_Open C:\Users\clsm\AppData\Roaming\Grasshopper\Dev.gh")
cardinal = ConstructCardinalSystem(TrueNorth=Slider(324, range=0..360))

# ---- group: i_ / ii_
# Inputs
data = Data(1)

# ---- group: u_ / uu_
# User Interfaces
data_2 = Data(1)

# ---- group: Default Colors + Auto Color Groups / Auto Colors
toggle = BooleanToggle(True)

# ---- group: Default Colors + Auto Color Groups
trigger = Trigger(Interval=20, TimerInterval=20, Target=date_color_default)
date_color_default = CSharpScript(run=toggle)  # -> DateModified; inputs run: Boolean
# ---------- date_color_default: C# usings ----------
using System.IO;
using System.Linq;
using System.Data;
using System.Drawing;
using System.Reflection;
using System.Windows.Forms;
using System.Xml;
using System.Xml.Linq;
using System.Runtime.InteropServices;

using Rhino.DocObjects;
using Rhino.Collections;
using GH_IO;
using GH_IO.Serialization;
# ---------- date_color_default: C# ----------
    //Get the Date Modified

    if(GrasshopperDocument.FilePath != null && File.Exists(GrasshopperDocument.FilePath)){
      //Get info about file
      System.IO.FileInfo file = new FileInfo(GrasshopperDocument.FilePath);
      //Get date created - This does not work for some reason...
      //Dc = file.CreationTime.ToString();

      //Get date modified
      DateModified = "\n" + "Last Updated: " + file.LastWriteTime.ToString();

    }

    //Automatically Set Default Colors

    if(run) {
      Grasshopper.GUI.Canvas.GH_Skin.panel_back = System.Drawing.Color.FromArgb(255, 0, 0, 0);
      Grasshopper.GUI.Canvas.GH_Skin.group_back = System.Drawing.Color.FromArgb(150, 0, 212, 255);
    }

    //Automatically color groups based on a text tag

    GrasshopperDocument.ObjectsAdded -= ObjectsAdded;
    GrasshopperDocument.ObjectsDeleted -= ObjectsRemoved;
    if(run)
    {

      if(firstRun){
        //        using (StreamWriter f = File.AppendText(@"C:\My Documents\Desktop\UndoLog.txt"))
        //        {
        //          f.WriteLine("FirstRun");
        //
        //        }
        var groups = GrasshopperDocument.Objects.OfType<Grasshopper.Kernel.Special.GH_Group>().ToList();
        groups.ForEach(g => attachEvent(g));

        groups.ForEach(g => colorGroup(g));

        var paramObjs = GrasshopperDocument.Objects.OfType<IGH_Param>().ToList();
        paramObjs.ForEach(p => attachParamEvent(p));


        firstRun = false;
      }

      GrasshopperDocument.ObjectsAdded += ObjectsAdded;
      GrasshopperDocument.ObjectsDeleted += ObjectsRemoved;
    } else {
      var groups = GrasshopperDocument.Objects.OfType<Grasshopper.Kernel.Special.GH_Group>().ToList();
      groups.ForEach(g => detachEvent(g));

      var paramObjs = GrasshopperDocument.Objects.OfType<IGH_Param>().ToList();

      paramObjs.ForEach(p => detachParamEvent(p));

      firstRun = true;

    }
# ---------- date_color_default: C# additional code ----------
  bool firstRun = true;
  void ObjectsAdded(object sender, GH_DocObjectEventArgs e){

    var groups = e.Objects.OfType<Grasshopper.Kernel.Special.GH_Group>();
    var paramObjs = e.Objects.OfType<IGH_Param>();
    if(groups.Count() == 0 && paramObjs.Count() == 0) return;

    foreach(Grasshopper.Kernel.Special.GH_Group grp in groups){

      attachEvent(grp);

    }

    foreach(IGH_Param prm in paramObjs){
      attachParamEvent(prm);
    }
  }

  void attachEvent(Grasshopper.Kernel.Special.GH_Group grp){
    grp.ObjectChanged += GroupAttributesChanged;
  }

  void attachParamEvent(IGH_Param param){
    param.ObjectChanged += ParamAttributesChanged;
  }

  void detachEvent(Grasshopper.Kernel.Special.GH_Group grp){
    grp.ObjectChanged -= GroupAttributesChanged;
  }
  void detachParamEvent(IGH_Param param){
    param.ObjectChanged += ParamAttributesChanged;
  }

  void ObjectsRemoved(object sender, GH_DocObjectEventArgs e){

    var groups = e.Objects.OfType<Grasshopper.Kernel.Special.GH_Group>();
    var paramObjs = e.Objects.OfType<IGH_Param>();
    if(groups.Count() == 0 && paramObjs.Count() == 0) return;

    foreach(Grasshopper.Kernel.Special.GH_Group grp in groups){

      detachEvent(grp);
    }

    foreach(IGH_Param prm in paramObjs){
      detachParamEvent(prm);
    }
  }

  void GroupAttributesChanged(object sender, EventArgs e){

    colorGroup(sender as Grasshopper.Kernel.Special.GH_Group);
  }


  void ParamAttributesChanged(object sender, GH_ObjectChangedEventArgs e){

    if(e.Type == GH_ObjectEventType.NickName || e.Type == GH_ObjectEventType.NickNameAccepted){

      e.Sender.IconDisplayMode = GH_IconDisplayMode.name;
    } else {
      // MessageBox.Show(e.Type.ToString());
    }
  }

  void colorGroup(Grasshopper.Kernel.Special.GH_Group grp){
    var groups = GrasshopperDocument.Objects.OfType<Grasshopper.Kernel.Special.GH_Group>();

    var keyGroups = groups.Where(g => g.NickName.Reverse().ToArray().FirstOrDefault() == '_');
    var otherGroups = groups.Except(keyGroups);

    if(keyGroups.Contains(grp)) return;

    var keyDictionary = keyGroups.ToDictionary(g => g.NickName, g => g.Colour);

    var splits = grp.NickName.Split('_');
    if(splits.Length == 1) return;
    var prefix = splits[0];
    prefix += '_';
    if(keyDictionary.ContainsKey(prefix)){
      grp.Colour = keyDictionary[prefix];
      grp.NickName = grp.NickName.Replace(prefix, "");

    }
  }
# ---------- end date_color_default ----------

# ----
# Colin Matthews
# colin.matthews@ennead.com
# mm/dd/yyyy
panel_5 = Panel(date_color_default)
script_description = Panel("Description of script")

cardinal_2 = DeconstructCardinalSystem(CardinalSystem=cardinal)  # -> TrueNorth, TrueEast, TrueSouth, TrueWest, ProjectNorth, ProjectEast, ProjectSouth, ProjectWest, Name
xy = XYPlane(Origin=Point(0, 0, 0))

# ---- group: s_ / ss_
# General Slider
data_3 = Data(1)

# ---- group: d_ / dd_
# Data Exchange
data_4 = Data(1)

# ---- group: g_ / gg_
# General
data_5 = Data(1)

# ---- group: 1_ / 11_
# General 1
data_6 = Data(1)

# ---- group: e_ / ee_
# Environmental
data_7 = Data(1)

# ---- group: 2_ / 22_
# General 2
# Use this color template. You can automatically assign group colors by typing the letter along with the "_" character and a group name. The group color will automatically be assigned
data_8 = Data(1)

# ---- group: o_ / oo_
# Outputs
data_9 = Data(1)

# ---- group: 3_ / 33_
# General 3
data_10 = Data(1)

# ---- group: 4_ / 44_
# General 4
data_11 = Data(1)

# ---- group: v_ / vv_
# Viz / Display
data_12 = Data(1)

# ----
vdisex = VectorDisplayEx(Point=xy, Vector=cardinal_2.TrueNorth, Colour=ColourSwatch(SwatchColor=RGB(255, 0, 0)), Width=Slider(3, range=0..10))
vdisex_2 = VectorDisplayEx(
    Point=xy,
    Vector=[cardinal_2.TrueEast, cardinal_2.TrueSouth, cardinal_2.TrueWest],
    Colour=ColourSwatch(SwatchColor=RGB(176, 70, 70)),
    Width=2)
vdisex_3 = VectorDisplayEx(Point=xy, Vector=cardinal_2.ProjectNorth, Colour=ColourSwatch(SwatchColor=RGB(0, 55, 255)), Width=Slider(6, range=0..10))
vdisex_4 = VectorDisplayEx(
    Point=xy,
    Vector=[cardinal_2.ProjectEast, cardinal_2.ProjectSouth, cardinal_2.ProjectWest],
    Colour=ColourSwatch(SwatchColor=RGB(87, 110, 194)),
    Width=Slider(4, range=0..10))

docinfo = DocumentInfo(AutoUpdate=Toggle(True), Recursive=False)  # -> DocumentName, DocumentFilePath, Components, Params, graft(_3rdPartyAssemblies)
panel_6 = Panel(docinfo._3rdPartyAssemblies)

# ---- group: Night Mode
# Set end of day
manual_state = ValueList({"Off": False, "On": True}, selected="On")
mode = ValueList({"Automatic": True, "Manual": False}, selected="Automatic")
trigger_2 = Trigger(Interval=20, TimerInterval=20, Target=python)
clock = Clock(SecondHand=True)
python = GhPythonScript(mode=mode, state=manual_state, clock=clock)  # -> out, time_now, time_remain, trigger; inputs mode: Boolean, state: Boolean
# ---------- python: Python ----------
from datetime import datetime, time

now = datetime.now()
time_now = now.strftime('%H:%M:%S')

clock = _clock.split(" ")[1].split(":")
check = time(int(clock[0]), int(clock[1]), int(clock[2]))
check_datetime = datetime.combine(now.date(), check)

time_difference = check_datetime - now

hours = time_difference.seconds // 3600
minutes = (time_difference.seconds // 60) % 60
seconds = time_difference.seconds % 60

time_remain = '{:02d}:{:02d}:{:02d}'.format(hours, minutes, seconds)

if _mode:
    trigger = (now.time() >= check)
else:
    trigger = _state
# ---------- end python ----------
current_time = Panel(python.time_now)
time_until_end_of_business_hours = Panel(python.time_remain)
moonlight = Moonlight(Mode=python.trigger)
